# Requirement set BSD_Requirements (R2024a)

Attributes:
- Category: Imported from Excel:Category
- Level: Imported from Excel:Level
- Priority / Keywords: Imported from Excel:Priority / Keywords

## 1 [BSD_Requirements!All Requirements] References to BSD_Requirements.xlsx (All Requirements) (Container)
Read-only references to Microsoft Excel document.

### 1.1 [SYS-FR] System Functional Requirements
System-level functional requirements from SRS-PRJ-002
Category: System FR
Level: 1

### 1.2 [FR-01] Object detection range
System shall detect objects within 3.0 m in the blind spot zone
Category: System FR
Level: 2
Priority / Keywords: High

### 1.3 [FR-02] Trigger visual warning
System shall enter WARNING state when object detected at distance < 3.0 m
Category: System FR
Level: 2
Priority / Keywords: High

### 1.4 [FR-03] Trigger critical alert
System shall enter ALERT state when object detected AND turn signal active
Category: System FR
Level: 2
Priority / Keywords: Critical

### 1.5 [FR-04] Reset warning state
System shall return to CLEAR state when distance exceeds 3.0 m
Category: System FR
Level: 2
Priority / Keywords: High

### 1.6 [FR-05] Actuate LED indicator
System shall output LED warning signal (0=OFF, 1=ON)
Category: System FR
Level: 2
Priority / Keywords: High

### 1.7 [FR-06] Receive radar data
System shall receive radar distance via CAN ID 0x200 (Left) and 0x201 (Right)
Category: System FR
Level: 2
Priority / Keywords: High

### 1.8 [FR-07] Receive vehicle speed
System shall receive vehicle speed via CAN ID 0x100
Category: System FR
Level: 2
Priority / Keywords: High

### 1.9 [FR-08] Receive turn signal
System shall receive turn signal status via CAN ID 0x3A0
Category: System FR
Level: 2
Priority / Keywords: High

### 1.10 [FR-09] Transmit HMI status
System shall transmit warning status via CAN ID 0x300 every 20 ms
Category: System FR
Level: 2
Priority / Keywords: High

### 1.11 [FR-10] Transmit BCM command
System shall transmit LED control via CAN ID 0x301 every 20 ms
Category: System FR
Level: 2
Priority / Keywords: Medium

### 1.12 [FR-11] Algorithm periodicity
BSD algorithm shall execute every 20 ms
Category: System FR
Level: 2
Priority / Keywords: High

### 1.13 [FR-12] Receive gear status
System shall receive gear status via CAN ID 0x1A0
Category: System FR
Level: 2
Priority / Keywords: Medium

### 1.14 [FR-13] Receive steering angle
System shall receive steering angle via CAN ID 0x2E0
Category: System FR
Level: 2
Priority / Keywords: Medium

### 1.15 [FR-14] Highway suppression
System shall ignore radar input when vehicle speed exceeds configured threshold
Category: System FR
Level: 2
Priority / Keywords: Medium

### 1.16 [FR-15] Report diagnostic failure
System shall report a DTC when radar signal status is invalid
Category: System FR
Level: 2
Priority / Keywords: Medium

### 1.17 [SYS-NFR] System Non-Functional Requirements
System non-functional requirements from SRS-PRJ-002
Category: System NFR
Level: 1

### 1.18 [NFR-01] Execution determinism
BSD_Algorithm_SWC execution jitter shall not exceed ±2 ms
Category: System NFR
Level: 2
Priority / Keywords: High

### 1.19 [NFR-02] Network bandwidth limit
CAN bus load contributed by BSD_ECU shall not exceed 5% at 500 kbit/s
Category: System NFR
Level: 2
Priority / Keywords: Medium

### 1.20 [NFR-03] CAN fault recovery
System shall recover from a bus-off condition automatically
Category: System NFR
Level: 2
Priority / Keywords: Medium

### 1.21 [NFR-04] Data integrity
All inter-task shared data shall be protected against race conditions (RTOS critical sections / Priority Ceiling)
Category: System NFR
Level: 2
Priority / Keywords: High

### 1.22 [NFR-05] Stack overflow detection
Stack usage per task shall be monitored at runtime (stack overflow detection)
Category: System NFR
Level: 2
Priority / Keywords: Medium

### 1.23 [VSG-FR] BSD_VehicleSignals_SWC Functional Requirements
Requirements from SRS-PRJ-002-VSG
Category: SWC-01 VSG
Level: 1

### 1.24 [VSG-FR-01] Read speed raw
The SWC shall read Vehicle_Speed_Raw (CAN 0x100) every execution cycle
Category: SWC-01 VSG
Level: 2
Priority / Keywords: High

### 1.25 [VSG-FR-02] Read turn signal raw
The SWC shall read Raw_turn_sig (CAN 0x3A0) every execution cycle
Category: SWC-01 VSG
Level: 2
Priority / Keywords: High

### 1.26 [VSG-FR-03] Read gear raw
The SWC shall read Gear_Raw (CAN 0x1A0) every execution cycle
Category: SWC-01 VSG
Level: 2
Priority / Keywords: Medium

### 1.27 [VSG-FR-04] Read steering raw
The SWC shall read Raw_steering (CAN 0x2E0) every execution cycle
Category: SWC-01 VSG
Level: 2
Priority / Keywords: Medium

### 1.28 [VSG-FR-05] Independent signal processing
The SWC shall process the four signals independently; a failure of one signal shall not change the status of another
Category: SWC-01 VSG
Level: 2
Priority / Keywords: High

### 1.29 [VSG-FR-06] Scale speed
The SWC shall convert speed using Vehicle_Speed = Vehicle_Speed_Raw x VSPD_RESOLUTION_KMH
Category: SWC-01 VSG
Level: 2
Priority / Keywords: High

### 1.30 [VSG-FR-07] Speed range check
The SWC shall set Speed_Status to SIGNAL_FAIL when Vehicle_Speed_Raw is outside [VSPD_RAW_MIN; VSPD_RAW_MAX]
Category: SWC-01 VSG
Level: 2
Priority / Keywords: High

### 1.31 [VSG-FR-08] Scale steering
The SWC shall convert steering angle using Steering_Angle = Raw_steering x STEER_RESOLUTION_DEG
Category: SWC-01 VSG
Level: 2
Priority / Keywords: Medium

### 1.32 [VSG-FR-09] Steering range check
The SWC shall set Steering_Status to SIGNAL_FAIL when Raw_steering is outside [STEER_RAW_MIN; STEER_RAW_MAX]
Category: SWC-01 VSG
Level: 2
Priority / Keywords: Medium

### 1.33 [VSG-FR-10] Decode turn signal
The SWC shall decode Raw_turn_sig to TurnSignal_T according to Section 5.2
Category: SWC-01 VSG
Level: 2
Priority / Keywords: Critical

### 1.34 [VSG-FR-11] Turn signal code check
The SWC shall set TurnSignal_Status to SIGNAL_FAIL when Raw_turn_sig holds an undefined code
Category: SWC-01 VSG
Level: 2
Priority / Keywords: Critical

### 1.35 [VSG-FR-12] Decode gear
The SWC shall decode Gear_Raw to Gear_T according to Section 5.2
Category: SWC-01 VSG
Level: 2
Priority / Keywords: Medium

### 1.36 [VSG-FR-13] Gear code check
The SWC shall set Gear_Status to SIGNAL_FAIL when Gear_Raw holds an undefined code
Category: SWC-01 VSG
Level: 2
Priority / Keywords: Medium

### 1.37 [VSG-FR-14] Failsafe outputs
When a signal status is SIGNAL_FAIL the SWC shall output the configured fail-safe value of that signal instead of a scaled or decoded value
Category: SWC-01 VSG
Level: 2
Priority / Keywords: High

### 1.38 [VSG-FR-15] Com timeout as FAIL
A frame timeout shall be indicated by the Com module timeout replacement value; the SWC shall treat this value as SIGNAL_FAIL
Category: SWC-01 VSG
Level: 2
Priority / Keywords: High

### 1.39 [VSG-FR-16] Init all FAIL
The SWC shall initialize all four signal statuses to SIGNAL_FAIL at startup and keep them until the first valid sample is received
Category: SWC-01 VSG
Level: 2
Priority / Keywords: High

### 1.40 [VSG-FR-17] Recovery hysteresis
The SWC shall return a signal from SIGNAL_FAIL to SIGNAL_OK after VSG_RECOVERY_CNT consecutive valid samples
Category: SWC-01 VSG
Level: 2
Priority / Keywords: Medium

### 1.41 [VSG-FR-18] Atomic channel write
The SWC shall write all elements of SRI_VehicleData in the same execution cycle so consumers never read values from different cycles
Category: SWC-01 VSG
Level: 2
Priority / Keywords: High

### 1.42 [VSG-FR-19] 20 ms period
The SWC shall execute every 20 ms
Category: SWC-01 VSG
Level: 2
Priority / Keywords: High

### 1.43 [VSG-FR-20] No boolean status
The SWC shall not use boolean types for any status signal; all validity information shall be exchanged as SignalStatus_T
Category: SWC-01 VSG
Level: 2
Priority / Keywords: High

### 1.44 [VSG-NFR] BSD_VehicleSignals_SWC Non-Functional Requirements
Non-functional requirements from SRS-PRJ-002-VSG
Category: SWC-01 VSG
Level: 1

### 1.45 [VSG-NFR-01] No dynamic memory
The SWC shall not use dynamic memory allocation
Category: SWC-01 VSG
Level: 2
Priority / Keywords: High

### 1.46 [VSG-NFR-02] MISRA C compliance
The SWC code shall comply with MISRA C:2012
Category: SWC-01 VSG
Level: 2
Priority / Keywords: High

### 1.47 [VSG-NFR-03] Determinism
The SWC shall be deterministic: the same inputs and internal state shall produce the same outputs
Category: SWC-01 VSG
Level: 2
Priority / Keywords: High

### 1.48 [VSG-NFR-04] Bounded execution time
The SWC execution time per cycle shall be bounded and shall not cause BSD_Algorithm_SWC to exceed its ±2 ms jitter limit
Category: SWC-01 VSG
Level: 2
Priority / Keywords: High

### 1.49 [VSG-NFR-05] Concurrency protection
Shared data written by the SWC shall be protected against race conditions
Category: SWC-01 VSG
Level: 2
Priority / Keywords: High

### 1.50 [VSG-NFR-06] Minimal state holding
The SWC shall hold only the state needed for validation: recovery counters per signal
Category: SWC-01 VSG
Level: 2
Priority / Keywords: Medium

### 1.51 [RIN-FR] BSD_RadarInput_SWC Functional Requirements
Requirements from SRS-PRJ-002-RIN
Category: SWC-02 RIN
Level: 1

### 1.52 [RIN-FR-01] Read left radar raw
The SWC shall read Distance_Raw and Status_Raw of the left radar (CAN 0x200) every execution cycle
Category: SWC-02 RIN
Level: 2
Priority / Keywords: High

### 1.53 [RIN-FR-02] Read right radar raw
The SWC shall read Distance_Raw and Status_Raw of the right radar (CAN 0x201) every execution cycle
Category: SWC-02 RIN
Level: 2
Priority / Keywords: High

### 1.54 [RIN-FR-03] Independent channels
The SWC shall process the left and right channels independently; a failure on one side shall not affect the status of the other side
Category: SWC-02 RIN
Level: 2
Priority / Keywords: High

### 1.55 [RIN-FR-04] Sensor status code check
The SWC shall set the channel status to RADAR_FAIL when Status_Raw does not equal the configured valid sensor code
Category: SWC-02 RIN
Level: 2
Priority / Keywords: High

### 1.56 [RIN-FR-05] Distance range check
The SWC shall set the channel status to RADAR_FAIL when Distance_Raw is outside the configured range [RADAR_RAW_MIN; RADAR_RAW_MAX]
Category: SWC-02 RIN
Level: 2
Priority / Keywords: High

### 1.57 [RIN-FR-07] OK only if no failure
The SWC shall set the channel status to RADAR_OK only when no failure condition of RIN-FR-04 or RIN-FR-05 is active
Category: SWC-02 RIN
Level: 2
Priority / Keywords: Critical

### 1.58 [RIN-FR-08] Scale distance
The SWC shall convert Distance_Raw to meters using Distance = Distance_Raw x RADAR_RESOLUTION_M
Category: SWC-02 RIN
Level: 2
Priority / Keywords: High

### 1.59 [RIN-FR-09] Failsafe distance
When the status is RADAR_FAIL the SWC shall output the configured fail-safe distance RADAR_DIST_FAILSAFE_M instead of a scaled value
Category: SWC-02 RIN
Level: 2
Priority / Keywords: High

### 1.60 [RIN-FR-10] Init both FAIL
The SWC shall initialize both channels to RADAR_FAIL at startup and keep that status until the first valid sample is received
Category: SWC-02 RIN
Level: 2
Priority / Keywords: High

### 1.61 [RIN-FR-11] Recovery hysteresis
The SWC shall return a channel from RADAR_FAIL to RADAR_OK once the configured number of consecutive valid samples (RADAR_RECOVERY_CNT) has been received
Category: SWC-02 RIN
Level: 2
Priority / Keywords: Medium

### 1.62 [RIN-FR-12] Atomic channel write
The SWC shall write the distance and status of one channel together in the same execution cycle so the algorithm never reads a distance from one cycle with a status from another
Category: SWC-02 RIN
Level: 2
Priority / Keywords: High

### 1.63 [RIN-FR-13] 20 ms period
The SWC shall execute every 20 ms matching the BSD algorithm period
Category: SWC-02 RIN
Level: 2
Priority / Keywords: High

### 1.64 [RIN-FR-14] No boolean status
The SWC shall not use boolean types for any status signal; all validity information shall be exchanged as RadarStatus_T
Category: SWC-02 RIN
Level: 2
Priority / Keywords: High

### 1.65 [RIN-NFR] BSD_RadarInput_SWC Non-Functional Requirements
Non-functional requirements from SRS-PRJ-002-RIN
Category: SWC-02 RIN
Level: 1

### 1.66 [RIN-NFR-01] No dynamic memory
The SWC shall not use dynamic memory allocation
Category: SWC-02 RIN
Level: 2
Priority / Keywords: High

### 1.67 [RIN-NFR-02] MISRA C compliance
The SWC code shall comply with MISRA C:2012
Category: SWC-02 RIN
Level: 2
Priority / Keywords: High

### 1.68 [RIN-NFR-03] Determinism
The SWC shall be deterministic: the same inputs and internal state shall always produce the same outputs
Category: SWC-02 RIN
Level: 2
Priority / Keywords: High

### 1.69 [RIN-NFR-04] Bounded execution time
The SWC execution time per cycle shall be bounded and shall not cause the BSD algorithm to exceed its ±2 ms jitter limit
Category: SWC-02 RIN
Level: 2
Priority / Keywords: High

### 1.70 [RIN-NFR-05] Concurrency protection
Shared data written by the SWC shall be protected against race conditions
Category: SWC-02 RIN
Level: 2
Priority / Keywords: High

### 1.71 [RIN-NFR-06] Minimal state holding
The SWC shall hold only the state needed for validation: recovery counters per channel
Category: SWC-02 RIN
Level: 2
Priority / Keywords: Medium

### 1.72 [ALG-FR] BSD_Algorithm_SWC Functional Requirements
Requirements from SRS-PRJ-002-ALG
Category: SWC-03 ALG
Level: 1

### 1.73 [ALG-FR-01] Read input states
The SWC shall read radar distances, statuses, vehicle speed, and turn signal states every execution cycle
Category: SWC-03 ALG
Level: 2
Priority / Keywords: High

### 1.74 [ALG-FR-02] Independent zone processing
The SWC shall process the left and right blind spot zones independently
Category: SWC-03 ALG
Level: 2
Priority / Keywords: High

### 1.75 [ALG-FR-03] Radar fault handling
The SWC shall treat radar distance as invalid (object not detected) if Status is RADAR_FAIL
Category: SWC-03 ALG
Level: 2
Priority / Keywords: High

### 1.76 [ALG-FR-04] Transition to WARNING
The SWC shall transition the state from BSD_CLEAR to BSD_WARNING when object distance < 3.0 m
Category: SWC-03 ALG
Level: 2
Priority / Keywords: High

### 1.77 [ALG-FR-05] Transition to CLEAR
The SWC shall transition the state from BSD_WARNING to BSD_CLEAR when object distance >= 3.0 m
Category: SWC-03 ALG
Level: 2
Priority / Keywords: High

### 1.78 [ALG-FR-06] Transition to ALERT
The SWC shall transition the state to BSD_ALERT when the state is BSD_WARNING AND the turn signal is active on the same side
Category: SWC-03 ALG
Level: 2
Priority / Keywords: Critical

### 1.79 [ALG-FR-07] Revert to WARNING
The SWC shall transition the state from BSD_ALERT to BSD_WARNING when the turn signal is deactivated
Category: SWC-03 ALG
Level: 2
Priority / Keywords: High

### 1.80 [ALG-FR-08] Highway suppression
The SWC shall force the state to BSD_CLEAR if vehicle speed exceeds the VSPD_SUPPRESSION_THRESHOLD (Highway suppression)
Category: SWC-03 ALG
Level: 2
Priority / Keywords: Medium

### 1.81 [ALG-FR-09] Failsafe on speed fail
The SWC shall force the state to BSD_CLEAR if Speed_Status is SIGNAL_FAIL (fail-safe behavior)
Category: SWC-03 ALG
Level: 2
Priority / Keywords: High

### 1.82 [ALG-FR-10] 20 ms period
The SWC shall execute every 20 ms
Category: SWC-03 ALG
Level: 2
Priority / Keywords: High

### 1.83 [ALG-FR-11] No boolean types
The SWC shall not use boolean types; all states shall be BSDState_T
Category: SWC-03 ALG
Level: 2
Priority / Keywords: High

### 1.84 [ALG-NFR] BSD_Algorithm_SWC Non-Functional Requirements
Non-functional requirements from SRS-PRJ-002-ALG
Category: SWC-03 ALG
Level: 1

### 1.85 [ALG-NFR-01] No dynamic memory
The SWC shall not use dynamic memory allocation
Category: SWC-03 ALG
Level: 2
Priority / Keywords: High

### 1.86 [ALG-NFR-02] MISRA C compliance
The SWC code shall comply with MISRA C:2012
Category: SWC-03 ALG
Level: 2
Priority / Keywords: High

### 1.87 [ALG-NFR-03] Execution jitter limit
Execution jitter shall not exceed ±2 ms
Category: SWC-03 ALG
Level: 2
Priority / Keywords: High

### 1.88 [WRN-FR] BSD_Warning_SWC Functional Requirements
Requirements from SRS-PRJ-002-WRN
Category: SWC-04 WRN
Level: 1

### 1.89 [WRN-FR-01] Read BSD states
The SWC shall read BSD_State_Left and BSD_State_Right every execution cycle
Category: SWC-04 WRN
Level: 2
Priority / Keywords: High

### 1.90 [WRN-FR-02] Publish states
The SWC shall output the states directly to Warning_State_Left and Warning_State_Right
Category: SWC-04 WRN
Level: 2
Priority / Keywords: High

### 1.91 [WRN-FR-03] LED left on
The SWC shall set LED_Left to LED_ON if BSD_State_Left is BSD_WARNING or BSD_ALERT
Category: SWC-04 WRN
Level: 2
Priority / Keywords: High

### 1.92 [WRN-FR-04] LED left off
The SWC shall set LED_Left to LED_OFF if BSD_State_Left is BSD_CLEAR
Category: SWC-04 WRN
Level: 2
Priority / Keywords: High

### 1.93 [WRN-FR-05] LED right on
The SWC shall set LED_Right to LED_ON if BSD_State_Right is BSD_WARNING or BSD_ALERT
Category: SWC-04 WRN
Level: 2
Priority / Keywords: High

### 1.94 [WRN-FR-06] LED right off
The SWC shall set LED_Right to LED_OFF if BSD_State_Right is BSD_CLEAR
Category: SWC-04 WRN
Level: 2
Priority / Keywords: High

### 1.95 [WRN-FR-07] Atomic write
The SWC shall write all elements of SRI_WarningOutput in the same execution cycle
Category: SWC-04 WRN
Level: 2
Priority / Keywords: High

### 1.96 [WRN-FR-08] 20 ms period
The SWC shall execute every 20 ms
Category: SWC-04 WRN
Level: 2
Priority / Keywords: High

### 1.97 [WRN-FR-09] No boolean outputs
The SWC shall not use boolean types for outputs; LED control shall be LedState_T (LED_ON or LED_OFF)
Category: SWC-04 WRN
Level: 2
Priority / Keywords: High

### 1.98 [WRN-NFR] BSD_Warning_SWC Non-Functional Requirements
Non-functional requirements from SRS-PRJ-002-WRN
Category: SWC-04 WRN
Level: 1

### 1.99 [WRN-NFR-01] No dynamic memory
The SWC shall not use dynamic memory allocation
Category: SWC-04 WRN
Level: 2
Priority / Keywords: High

### 1.100 [WRN-NFR-02] MISRA C compliance
The SWC code shall comply with MISRA C:2012
Category: SWC-04 WRN
Level: 2
Priority / Keywords: High

### 1.101 [WRN-NFR-03] Determinism
The SWC shall be deterministic
Category: SWC-04 WRN
Level: 2
Priority / Keywords: High

### 1.102 [DIA-FR] BSD_Diagnostic_SWC Functional Requirements
Requirements from SRS-PRJ-002-DIA
Category: SWC-05 DIA
Level: 1

### 1.103 [DIA-FR-01] Read radar statuses
The SWC shall read the Status of Radar Left and Radar Right every cycle
Category: SWC-05 DIA
Level: 2
Priority / Keywords: High

### 1.104 [DIA-FR-02] Read vehicle signal statuses
The SWC shall read Speed_Status; TurnSignal_Status; Gear_Status and Steering_Status every cycle
Category: SWC-05 DIA
Level: 2
Priority / Keywords: High

### 1.105 [DIA-FR-03] Per-signal debounce counters
The SWC shall maintain an independent debounce counter for each of the 6 monitored signals
Category: SWC-05 DIA
Level: 2
Priority / Keywords: High

### 1.106 [DIA-FR-04] Increment on FAIL
If a signal status is FAIL the SWC shall increment its corresponding debounce counter
Category: SWC-05 DIA
Level: 2
Priority / Keywords: High

### 1.107 [DIA-FR-05] Reset on OK
If a signal status is OK the SWC shall reset its corresponding debounce counter to 0
Category: SWC-05 DIA
Level: 2
Priority / Keywords: High

### 1.108 [DIA-FR-06] Report FAILED
The SWC shall set the event status to DIAG_EVT_FAILED when the debounce counter reaches DIAG_DEBOUNCE_CNT
Category: SWC-05 DIA
Level: 2
Priority / Keywords: High

### 1.109 [DIA-FR-07] Report PASSED
The SWC shall set the event status to DIAG_EVT_PASSED when the debounce counter is reset to 0
Category: SWC-05 DIA
Level: 2
Priority / Keywords: High

### 1.110 [DIA-FR-08] 20 ms period
The SWC shall execute every 20 ms
Category: SWC-05 DIA
Level: 2
Priority / Keywords: High

### 1.111 [DIA-FR-09] No boolean statuses
The SWC shall not use boolean types; all event statuses shall be DiagEventStatus_T
Category: SWC-05 DIA
Level: 2
Priority / Keywords: High

### 1.112 [DIA-NFR] BSD_Diagnostic_SWC Non-Functional Requirements
Non-functional requirements from SRS-PRJ-002-DIA
Category: SWC-05 DIA
Level: 1

### 1.113 [DIA-NFR-01] No dynamic memory
The SWC shall not use dynamic memory allocation
Category: SWC-05 DIA
Level: 2
Priority / Keywords: High

### 1.114 [DIA-NFR-02] MISRA C compliance
The SWC code shall comply with MISRA C:2012
Category: SWC-05 DIA
Level: 2
Priority / Keywords: High

### 1.115 [DIA-NFR-03] Bounded execution time
The SWC execution time shall be bounded
Category: SWC-05 DIA
Level: 2
Priority / Keywords: High